# Grasshopper definition 010_bilibili_FoldedPanel_DotsRandomGradient.gh (Grasshopper 1.0.7)
# plug-ins: Pufferfish, LunchBox, Imaging Library

srf = Surface(<surface referenced from the Rhino model>)
data = Data(srf)
deconstruct_brep = DeconstructBrep(Brep=data)  # -> Faces, Edges, Vertices

# ----
# ISOLATING BREP
curve_middle = CurveMiddle(Curve=deconstruct_brep.Edges)
deconstruct = Deconstruct(Point=curve_middle)  # -> XComponent, YComponent, ZComponent
highest_lowest_numbers = HighestLowestNumbers(Numbers=deconstruct.ZComponent)  # -> Highest, Lowest
equality = Equality(FirstNumber=deconstruct.ZComponent, SecondNumber=highest_lowest_numbers.Lowest)  # -> Equality, Inequality
cull_pattern = CullPattern(List=deconstruct_brep.Edges, CullPattern=equality.Equality)
# LOBBY ELEVATOR PANELS THAT ARE PERFORATED - 07
curve_middle_2 = CurveMiddle(Curve=cull_pattern)
cylinder = Cylinder(Base=curve_middle_2, Radius=Slider(678, range=0..1000), Length=Slider(19, range=0..1000))
cap_holes = CapHoles(Brep=cylinder)

# ----
# GRID SPACING
number_slider = Slider(40, range=0..100)

# ----
# GRID
number_slider_2 = Slider(1, range=0..3)
list_item = ListItem(List=deconstruct_brep.Edges, Index=number_slider_2, Wrap=True)
list_item_2 = ListItem(List=deconstruct_brep.Edges, Index=Slider(2, range=0..3), Wrap=True)
length = Length(Curve=list_item)
length_2 = Length(Curve=list_item_2)
integer_division = IntegerDivision(A=length, B=number_slider)
integer_division_2 = IntegerDivision(A=length_2, B=number_slider)
integer = Integer(integer_division_2)
integer_2 = Integer(integer_division)
diamond_grid = DiamondGrid(Surface=data, UDivisions=integer, VDivisions=integer_2)  # -> CornerPoint1, CornerPoint2, CornerPoint3, CornerPoint4, MidPoint, Normals
point = Point(diamond_grid.MidPoint)
plane_normal = PlaneNormal(Origin=point, ZAxis=diamond_grid.Normals)

# ----
# ISOLATED
# PLANES
boolean_toggle = BooleanToggle(False)
point_in_brep = PointInBrep(Brep=cap_holes, Point=plane_normal, Strict=False)
equality_2 = Equality(FirstNumber=point_in_brep, SecondNumber=boolean_toggle)  # -> Equality, Inequality
cull_pattern_2 = CullPattern(List=plane_normal, CullPattern=equality_2.Equality)

data_2 = Data(cull_pattern_2)
point_2 = Point(data_2)
xy_plane = XYPlane(Origin=Point(0, 0, 0))
project = Project(Geometry=point_2, Plane=xy_plane)  # -> Geometry, Transform

# ----
# ORIGINAL
# CIRCLE
# RADIUS
number_slider_3 = Slider(20, range=0..100)

# ----
# RADII SCALE
number_slider_4 = Slider(1, range=0..1)

distance = Distance(PointA=point_2, PointB=project.Geometry)
data_3 = Data(distance)
bounds = Bounds(Numbers=data_3)
construct_domain = ConstructDomain(DomainStart=number_slider_4, DomainEnd=Slider(0.25, range=0..1))
remap_numbers = RemapNumbers(Value=data_3, Source=bounds, Target=construct_domain)  # -> Mapped, Clipped
polygon = Polygon(Plane=data_2, Radius=number_slider_3, Segments=Slider(20, range=0..100), FilletRadius=0)  # -> Polygon, Length
graph_mapper = GraphMapper(
    remap_numbers.Mapped,
    x0=0,
    x1=1,
    y0=0,
    y1=1,
    container_name="Bezier",
    cpx=[0, 0.461730063, 0.7371100783, 1],
    cpy=[0, 0.2876896262, 0.5509652495, 1])
scale = Scale(Geometry=polygon.Polygon, Center=point_2, Factor=graph_mapper)  # -> Geometry, Transform
panel = Panel("C:\Users\40452\OneDrive - Gensler\Desktop\010_20231110.png")  # disabled

# ----
# GRADUAL REDUCTION
data_4 = Data(scale.Geometry)
area = Area(Geometry=data_4)  # -> Area, Centroid
xy_plane_2 = XYPlane(Origin=Point(0, 0, 0))
construct_domain_2 = ConstructDomain(DomainStart=Slider(0, range=0..1), DomainEnd=Slider(1, range=0..1))

# ----
# GOMETRY LIST TO
# GRADUALY SELECT
flatten_tree = FlattenTree(Tree=data_4, Path="{0}")

# ----
# POINT IN
# GEOMETRY
# TO GRADUALLY
# SELECT
flatten_tree_2 = FlattenTree(Tree=area.Centroid, Path="{0}")

point_3 = Point(flatten_tree_2)
project_2 = Project(Geometry=point_3, Plane=xy_plane_2)  # -> Geometry, Transform
distance_2 = Distance(PointA=point_3, PointB=project_2.Geometry)
reparameterize_numbers = ReparameterizeNumbers(Numbers=distance_2, Invert=False)  # -> Reparameterized, Original
graph_mapper_2 = GraphMapper(
    reparameterize_numbers.Reparameterized,
    x0=0,
    x1=1,
    y0=0,
    y1=1,
    container_name="Bezier",
    cpx=[0, 0.5667530298, 0.4645677507, 1],
    cpy=[0, 0.280315876, 0.7363564372, 0.8829823136])
list_length = ListLength(List=point_3)
bounds_2 = Bounds(Numbers=graph_mapper_2)
random = Random(Range=Domain(0, 1), Number=list_length, Seed=Slider(14, range=0..20))
remap_numbers_2 = RemapNumbers(Value=graph_mapper_2, Source=bounds_2, Target=construct_domain_2)  # -> Mapped, Clipped
smaller_than = SmallerThan(FirstNumber=remap_numbers_2.Mapped, SecondNumber=random)  # -> SmallerThan, OrEqualTo
cull_pattern_3 = CullPattern(List=flatten_tree, CullPattern=smaller_than.SmallerThan)

# ----
# Take Long Time !!!!!
fill = CreateGdiFill(Colour=RGB(0, 0, 0))  # disabled
crv = Curve(<curve referenced from the Rhino model>)  # disabled
swatch = ColourSwatch(SwatchColor=RGB(255, 255, 255))  # disabled
shape = CreateGdiShape(Geometry=cull_pattern_3, Fill=fill)  # disabled
rec = Rectangle(crv)  # disabled
draw = DrawImage(Shapes=shape, Size=rec, Factor=1, Background=swatch, AntiAlias=True, FileLocation=panel)  # disabled
