# Grasshopper definition 011_PerforationLinearControl.gh (Grasshopper 1.0.7)
# plug-ins: Imaging Library

crv = Curve(<curve referenced from the Rhino model>)
area = Area(Geometry=crv)  # -> Area, Centroid

# ----
# Get UV Points
spacing = Slider(40, range=0..100)
boundary = BoundarySurfaces(Edges=crv)
bbox = BoundingBox(Content=crv, Plane=PlaneXY(0, 0, 0))  # -> Box, Box_2
debox = DeconstructBox(Box=bbox.Box)  # -> Plane, X, Y, Z
cluster = Cluster(list=debox.Y)
cluster_2 = Cluster(list=debox.X)
int = Integer(cluster)
int_2 = Integer(cluster_2)

# ----
# Left Bottom Corner Point
division = Division(A=int, B=2)
division_2 = Division(A=int_2, B=2)
X = UnitX(Factor=division_2)
Y = UnitY(Factor=division)
neg = Negative(Value=X)
neg_2 = Negative(Value=Y)
move = Move(Geometry=area.Centroid, Motion=neg)  # -> Geometry, Transform
move_2 = Move(Geometry=move.Geometry, Motion=neg_2)  # -> Geometry, Transform

# ----
# generate Triangle Points
number_slider = Slider(1.2, range=0..10)
division_3 = Division(A=cluster_2, B=spacing)
division_4 = Division(A=cluster, B=spacing)
multiplication = Multiplication(A=division_4, B=number_slider)
multiplication_2 = Multiplication(A=division_3, B=Slider(2.1, range=0..10))
trigrid = Triangular(Plane=move_2.Geometry, Size=spacing, ExtentX=multiplication_2, ExtentY=multiplication)  # -> Cells, Points

radius_max = Slider(15, range=0..100)
radius_min = Slider(3, range=0..100)
dom = ConstructDomain(DomainStart=radius_max, DomainEnd=radius_min)

# ----
# Select Points within region
cp = ControlPoints(Curve=trigrid.Cells)  # -> Points, Weights, Knots
item = ListItem(List=cp.Points, Index=0, Wrap=True)  # -> flatten(Item)
incurves = PointInCurves(Point=item, Curves=crv)  # -> Relationship, Index, Point
equals = Equality(FirstNumber=incurves.Relationship, SecondNumber=2)  # -> Equality, Inequality
dispatch = Dispatch(List=item, DispatchPattern=equals.Equality)  # -> ListA, ListB
data = Data(dispatch.ListA)

pdecon = Deconstruct(Point=data)  # -> flatten(XComponent), flatten(YComponent), ZComponent
bnd = Bounds(Numbers=pdecon.XComponent)
remap = RemapNumbers(Value=pdecon.XComponent, Source=bnd, Target=dom)  # -> Mapped, Clipped

# ---- group: optimize for Speed
int_3 = Integer(remap.Mapped)
cir = Circle(Plane=data, Radius=int_3)
polygon = Polygon(Plane=data, Radius=int_3, Segments=Slider(16, range=0..100), FilletRadius=0)  # -> Polygon, Length

# ----
# Take Long Time !!!!!
fill = CreateGdiFill(Colour=RGB(0, 0, 0))
crv_2 = Curve(crv)
shape = CreateGdiShape(Geometry=polygon.Polygon, Fill=fill)
rec = Rectangle(crv_2)
draw = DrawImage(
    Shapes=shape,
    Size=rec,
    Factor=1,
    Background=ColourSwatch(SwatchColor=RGB(255, 255, 255)),
    AntiAlias=True,
    FileLocation="C:\Users\40452\OneDrive - Gensler\Desktop\GH_Exported.png")

panel = Panel(remap.Mapped)

# ==== cluster Cluster
list = ClusterInput()  # List of domins
dedomain = DeconstructDomain(Domain=list)  # -> Start, End
subtraction = Subtraction(A=dedomain.End, B=dedomain.Start)
abs = Absolute(Value=subtraction)
list_2 = ClusterOutput(abs)  # List of ranges for domins
