# Grasshopper definition 012_PerforatedMetal_Graphic.gh (Grasshopper 1.0.7)
# plug-ins: Imaging Library

spacing_center_to_center = Slider(45, range=0..100)
radius_of_circle = Slider(15, range=0..100)
sheet_width = Slider(297, range=0..1000)
sheet_height = Slider(420, range=0..1000)
pt = ConstructPoint(XCoordinate=0, YCoordinate=0, ZCoordinate=0)
rectangle = Rectangle(Plane=pt, XSize=sheet_width, YSize=sheet_height, Radius=0)  # -> Rectangle, Length
crv = Curve(rectangle.Rectangle)

# ----
# generate Triangle Points
number_slider = Slider(1.2, range=0..10)
division = Division(A=sheet_width, B=spacing_center_to_center)
division_2 = Division(A=sheet_height, B=spacing_center_to_center)
multiplication = Multiplication(A=division_2, B=number_slider)
multiplication_2 = Multiplication(A=division, B=Slider(2.1, range=0..10))
trigrid = Triangular(Plane=pt, Size=spacing_center_to_center, ExtentX=multiplication_2, ExtentY=multiplication)  # -> flatten(Cells), Points

# ----
# Select Points within region
# in Curve
cp = ControlPoints(Curve=trigrid.Cells)  # -> Points, Weights, Knots
item = ListItem(List=cp.Points, Index=0, Wrap=True)
crv_cp = CurveClosestPoint(Point=item, Curve=rectangle.Rectangle)  # -> Point, Parameter, Distance
incurves = PointInCurves(Point=item, Curves=crv)  # -> Relationship, Index, Point
larger = LargerThan(FirstNumber=crv_cp.Distance, SecondNumber=radius_of_circle)  # -> LargerThan, OrEqualTo
equals = Equality(FirstNumber=incurves.Relationship, SecondNumber=2)  # -> Equality, Inequality
and = GateAnd(A=equals.Equality, B=larger.LargerThan)
dispatch = Dispatch(List=item, DispatchPattern=and)  # -> ListA, ListB

data = Data(dispatch.ListA)
polygon = Polygon(Plane=data, Radius=radius_of_circle, Segments=Slider(40, range=0..100), FilletRadius=0)  # -> flatten(Polygon), Length

# ----
# Take Long Time !!!!!
fill = CreateGdiFill(Colour=RGB(0, 0, 0))
shape = CreateGdiShape(Geometry=polygon.Polygon, Fill=fill)
draw = DrawImage(
    Shapes=shape,
    Size=rectangle.Rectangle,
    Factor=Slider(2, range=0..10),
    Background=ColourSwatch(SwatchColor=RGB(255, 255, 255)),
    AntiAlias=True,
    FileLocation="C:\Users\40452\OneDrive - Gensler\Desktop\22.png")

panel = Panel(larger.LargerThan)
