# Grasshopper definition 013_Staircase_Balustrade.gh (Grasshopper 1.0.7)

crv = Curve(<curve referenced from the Rhino model>)
panel_maxwidth = Slider(1000, range=0..1000)
panel_thickness = Slider(25, range=0..1000)
panel_depth = Slider(20, range=0..100)
stringer_depth = Slider(80, range=0..100)
panel_height = Slider(1200, range=0..10000)
panel_gap = Slider(15, range=0..1000)
railing_height = Slider(1000, range=0..1000)
railing_radius = Slider(20, range=0..100)
railing_offset = Slider(100, range=0..100)
explode = Explode(Curve=crv, Recursive=True)  # -> flatten(Segments), Vertices
len = Length(Curve=explode.Segments)
Z = UnitZ(Factor=1)
division = Division(A=len, B=panel_maxwidth)
multiplication = Multiplication(A=panel_thickness)
division_2 = Division(A=panel_thickness, B=2)
division_3 = Division(A=stringer_depth, B=2)
round = Round(Number=division)  # -> Nearest, Floor, Ceiling
offset = OffsetCurve(Curve=crv, Distance=railing_offset, Plane=Z, Corners=1)
Z_2 = UnitZ(Factor=railing_height)
addition = Addition(A=panel_height, B=multiplication)
subtraction = Subtraction(A=division_3, B=panel_thickness)
neg = Negative(Value=multiplication)
divide = DivideCurve(Curve=graft(explode.Segments), Count=graft(round.Ceiling), Kinks=False)  # -> Points, Tangents, Parameters
shatter = Shatter(Curve=graft(explode.Segments), Parameters=divide.Parameters)
move = Move(Geometry=offset, Motion=Z_2)  # -> Geometry, Transform
Z_3 = UnitZ(Factor=addition)
extr = Extrude(Base=flatten(shatter), Direction=graft(Z_3))
edges = BrepEdges(Brep=extr)  # -> Naked, Interior, NonManifold
join = JoinCurves(Curves=edges.Naked, Preserve=False)  # -> flatten(Curves)
neg_2 = Negative(Value=panel_gap)
data = Data(join)
offset_2 = OffsetCurve(Curve=data, Distance=neg_2, Corners=1)  # -> flatten(Curve)
Z_4 = UnitZ(Factor=neg_2)
move_2 = Move(Geometry=offset_2, Motion=Z_4)  # -> Geometry, Transform
offset_3 = OffsetCurve(Curve=move_2.Geometry, Distance=neg, Corners=1)  # -> flatten(Curve)
boundary = BoundarySurfaces(Edges=[move_2.Geometry, offset_3])
pln = Plane(boundary)
deplane = DeconstructPlane(Plane=pln)  # -> Origin, XAxis, YAxis, expr("-x", ZAxis)

number_slider = Slider(10, range=0..10)
boundary_2 = BoundarySurfaces(Edges=offset_3)
amp = Amplitude(Vector=deplane.ZAxis, Amplitude=number_slider)
division_4 = Division(A=number_slider, B=2)
extr_2 = Extrude(Base=boundary_2, Direction=amp)
neg_3 = Negative(Value=division_4)
amp_2 = Amplitude(Vector=deplane.ZAxis, Amplitude=neg_3)
move_3 = Move(Geometry=extr_2, Motion=amp_2)  # -> Geometry, Transform

division_5 = Division(A=panel_depth, B=2)
amp_3 = Amplitude(Vector=deplane.ZAxis, Amplitude=panel_depth)
amp_4 = Amplitude(Vector=deplane.ZAxis, Amplitude=division_5)
neg_4 = Negative(Value=amp_4)
extr_3 = Extrude(Base=boundary, Direction=amp_3)
move_4 = Move(Geometry=extr_3, Motion=neg_4)  # -> Geometry, Transform

# ---- group: Ouput
group = Group(Objects=flatten(move_3.Geometry))
group_2 = Group(Objects=flatten(move_4.Geometry))
pipe = Pipe(Curve=move.Geometry, Radius=railing_radius, Caps=Toggle(True))
