# Grasshopper definition 014_Staircase_Balustrade_Glass.gh (Grasshopper 1.0.7)

railing_height = Slider(1000, range=0..1000)
railing_radius = Slider(20, range=0..100)
panel_maxwidth = Slider(1000, range=0..1000)
railing_offset = Slider(100, range=0..100)
panel_height = Slider(1200, range=0..10000)
panel_gap = Slider(10, range=0..1000)
panel_thickness = Slider(10, range=0..10)
crv = Curve([<curve referenced from the Rhino model> x3])
Z = UnitZ(Factor=1)
explode = Explode(Curve=crv, Recursive=True)  # -> flatten(Segments), Vertices

# ---- group: Divide Crvs
len = Length(Curve=explode.Segments)
division = Division(A=len, B=panel_maxwidth)
round = Round(Number=division)  # -> Nearest, Floor, Ceiling
divide = DivideCurve(Curve=graft(explode.Segments), Count=graft(round.Ceiling), Kinks=False)  # -> Points, Tangents, Parameters
shatter = Shatter(Curve=graft(explode.Segments), Parameters=divide.Parameters)

# ----
offset = OffsetCurve(Curve=crv, Distance=railing_offset, Plane=Z, Corners=1)
Z_2 = UnitZ(Factor=railing_height)
multiplication = Multiplication(A=panel_gap)
move = Move(Geometry=offset, Motion=Z_2)  # -> Geometry, Transform
addition = Addition(A=panel_height, B=multiplication)
neg = Negative(Value=multiplication)

# ---- group: make Panel and seams
Z_3 = UnitZ(Factor=addition)
extr = Extrude(Base=flatten(shatter), Direction=graft(Z_3))
edges = BrepEdges(Brep=extr)  # -> Naked, Interior, NonManifold
join = JoinCurves(Curves=edges.Naked, Preserve=False)  # -> flatten(Curves)
neg_2 = Negative(Value=panel_gap)
data = Data(join)
offset_2 = OffsetCurve(Curve=data, Distance=neg_2, Corners=1)  # -> flatten(Curve)
Z_4 = UnitZ(Factor=neg_2)
move_2 = Move(Geometry=offset_2, Motion=Z_4)  # -> Geometry, Transform

# ---- group: make thickness
boundary = BoundarySurfaces(Edges=move_2.Geometry)
pln = Plane(boundary)
deplane = DeconstructPlane(Plane=pln)  # -> Origin, XAxis, YAxis, expr("-x", ZAxis)
amp = Amplitude(Vector=deplane.ZAxis, Amplitude=panel_thickness)
division_2 = Division(A=panel_thickness, B=2)
extr_2 = Extrude(Base=boundary, Direction=amp)
neg_3 = Negative(Value=division_2)
amp_2 = Amplitude(Vector=deplane.ZAxis, Amplitude=neg_3)
move_3 = Move(Geometry=extr_2, Motion=amp_2)  # -> Geometry, Transform

# ---- group: Ouput
group = Group(Objects=flatten(move_3.Geometry))
pipe = Pipe(Curve=move.Geometry, Radius=railing_radius, Caps=Toggle(True))
