# Grasshopper definition 016_FlowAlongSrf.gh (Grasshopper 1.0.7)

# ---- group: Target Geo
srf = Surface(<surface referenced from the Rhino model>)
pt = Point(<point referenced from the Rhino model>)
srf_cp = SurfaceClosestPoint(Point=pt, Surface=srf)  # -> Point, UVPoint, Distance

# ---- group: Base Geo
srf_2 = Surface(<surface referenced from the Rhino model>)
pt_2 = Point(<point referenced from the Rhino model>)
srf_cp_2 = SurfaceClosestPoint(Point=pt_2, Surface=srf_2)  # -> Point, UVPoint, Distance

# ---- group: Geo
brep = Brep([<brep referenced from the Rhino model> x3])

# ----
sporph = Sporph(G=brep, S0=srf_2, P0=srf_cp_2.UVPoint, S1=srf, P1=srf_cp.UVPoint, R=False)
