# Grasshopper definition 017_GradientArray.gh (Grasshopper 1.0.7)
# plug-ins: eleFront

crv = Curve(<curve referenced from the Rhino model>)
number_slider = Slider(10, range=0..10)
offset_left = Slider(25, range=0..100)
len = Length(Curve=crv)
range = Range(Domain=Domain(0, 1), Steps=Slider(50, range=0..100))
number_slider_2 = Slider(1000, range=0..1000)
graph = GraphMapper(
    range,
    x0=0,
    x1=1,
    y0=0,
    y1=1,
    container_name="Bezier",
    cpx=[0, 0.5449404716, 0.6250433326, 1],
    cpy=[0, 0.2172201276, 0.751241684, 1])
multiplication = Multiplication(A=offset_left, B=2)
subtraction = Subtraction(A=len, B=multiplication)
multiplication_2 = Multiplication(A=Slider(73, range=0..100, expression="0.01*x"), B=subtraction)
multiplication_3 = Multiplication(A=multiplication_2, B=graph)
addition = Addition(A=multiplication_3, B=offset_left)
eval = EvaluateCurve(Curve=crv, Parameter=addition)  # -> Point, Tangent, Angle
insert = InsertBlock(BlockName="Rod", Plane=eval.Point)
group = Group(Objects=insert)
