# Grasshopper definition 018_SrfTruss.gh (Grasshopper 1.0.7)
# plug-ins: LunchBox

number_slider = Slider(30, range=0..100)
number_slider_2 = Slider(5, range=0..10)
srf = Surface(<surface referenced from the Rhino model>)
tric = TrianglePanelsC(Surface=srf, UDivisions=number_slider_2, VDivisions=number_slider)
number_slider_3 = Slider(40, range=0..100)
gridbraced2d = BracedGrid2DStructure(Surface=srf, UDivisions=number_slider_2, VDivisions=number_slider)  # -> PrimaryLines, BraceLines, StructureNodes
data = Data(gridbraced2d.BraceLines)
data_2 = Data(gridbraced2d.PrimaryLines)
data_3 = Data(number_slider_3)
data_4 = Data(number_slider_3)

# ---- group: round truss
pipe = Pipe(Curve=data, Radius=number_slider_3, Caps=0)  # -> flatten(Pipe)
pipe_2 = Pipe(Curve=data_2, Radius=number_slider_3, Caps=0)  # -> flatten(Pipe)
group = Group(Objects=[pipe_2, pipe])

# ----
pipe_rod = Pipe_Rod(lines=data, size=number_slider_3)
pipe_rod_2 = Pipe_Rod(lines=data_2, size=number_slider_3)
group_2 = Group(Objects=[pipe_rod_2, pipe_rod])

# ==== cluster Pipe_Rod
size = ClusterInput()
lines = ClusterInput()
size_2 = Data(size)
lines_2 = Data(lines)
len = Length(Curve=lines_2)
end = EndPoints(Curve=lines_2)  # -> Start, End
midpt = CurveMiddle(Curve=lines_2)
vec2pt = Vector2Pt(PointA=midpt, PointB=end.Start, Unitize=False)  # -> Vector, Length
pl = PlaneNormal(Origin=midpt, ZAxis=vec2pt.Vector)
middle_domain = MiddleDomain(A=size_2)
middle_domain_2 = MiddleDomain(A=len)
box = DomainBox(Base=pl, X=middle_domain, Y=middle_domain, Z=middle_domain_2)
B = ClusterOutput(box)

# ==== cluster MiddleDomain
A = ClusterInput()
division = Division(A=A, B=2)
neg = Negative(Value=division)
dom = ConstructDomain(DomainStart=neg, DomainEnd=division)
I = ClusterOutput(dom)
