# Grasshopper definition 020_PerforationWithDis_LinearGradient.gh (Grasshopper 1.0.7)
# plug-ins: Imaging Library

crv = Curve(<curve referenced from the Rhino model>)
area = Area(Geometry=crv)  # -> Area, Centroid

# ----
# Get UV Points
spacing = Slider(100, range=0..1000)
boundary = BoundarySurfaces(Edges=crv)
bbox = BoundingBox(Content=crv, Plane=PlaneXY(0, 0, 0))  # -> Box, Box_2
debox = DeconstructBox(Box=bbox.Box)  # -> Plane, X, Y, Z
cluster = Cluster(list=debox.X)
cluster_2 = Cluster(list=debox.Y)
int = Integer(cluster_2)
int_2 = Integer(cluster)

# ----
# Left Bottom Corner Point
division = Division(A=int, B=2)
division_2 = Division(A=int_2, B=2)
X = UnitX(Factor=division_2)
Y = UnitY(Factor=division)
neg = Negative(Value=X)
neg_2 = Negative(Value=Y)
move = Move(Geometry=area.Centroid, Motion=neg)  # -> Geometry, Transform
move_2 = Move(Geometry=move.Geometry, Motion=neg_2)  # -> Geometry, Transform

# ----
# generate Triangle Points
number_slider = Slider(1.2, range=0..10)
division_3 = Division(A=cluster, B=spacing)
division_4 = Division(A=cluster_2, B=spacing)
multiplication = Multiplication(A=division_4, B=number_slider)
multiplication_2 = Multiplication(A=division_3, B=Slider(2, range=0..10))
trigrid = Triangular(Plane=move_2.Geometry, Size=spacing, ExtentX=multiplication_2, ExtentY=multiplication)  # -> Cells, Points

# ----
# Select Points within region
cp = ControlPoints(Curve=trigrid.Cells)  # -> Points, Weights, Knots
item = ListItem(List=cp.Points, Index=0, Wrap=True)  # -> flatten(Item)
incurves = PointInCurves(Point=item, Curves=crv)  # -> Relationship, Index, Point
equals = Equality(FirstNumber=incurves.Relationship, SecondNumber=2)  # -> Equality, Inequality
dispatch = Dispatch(List=item, DispatchPattern=equals.Equality)  # -> ListA, ListB
data = Data(dispatch.ListA)

crv_cp = CurveClosestPoint(Point=data, Curve=crv)  # -> Point, Parameter, Distance

# ----
# Distance Clip
# Max Control
# Min Control
max = Slider(3000, range=0..10000)
min = Slider(50, range=0..1000)
data_2 = Data(crv_cp.Distance)
cluster_3 = Cluster_2(replace_num=max, list=data_2, data=data_2, control_num=max)  # -> smaller_2, larger_2
bnd = Bounds(Numbers=cluster_3.larger_2)
data_3 = Data(cluster_3.larger_2)
cluster_4 = Cluster_2(replace_num=min, list=data_3, data=data_3, control_num=min)  # -> smaller_2, larger_2
int_3 = Integer(cluster_4.smaller_2)
bnd_2 = Bounds(Numbers=int_3)

pdecon = Deconstruct(Point=data)  # -> XComponent, YComponent, ZComponent
bnd_3 = Bounds(Numbers=pdecon.YComponent)
dom = ConstructDomain(DomainStart=0.1, DomainEnd=Slider(1.5, range=0..10))
remap = RemapNumbers(Value=pdecon.YComponent, Source=bnd_3, Target=dom)  # -> Mapped, Clipped

# ----
# Remap Distance
radius_max = Slider(30, range=0..100)
radius_min = Slider(5, range=0..100)
dom_2 = ConstructDomain(DomainStart=radius_min, DomainEnd=radius_max)
remap_2 = RemapNumbers(Value=int_3, Source=bnd_2, Target=dom_2)  # -> Mapped, Clipped
int_4 = Integer(remap_2.Mapped)

multiplication_3 = Multiplication(A=int_4, B=remap.Mapped)

# ---- group: filter mini
polygon = Polygon(Plane=data, Radius=multiplication_3, Segments=Slider(12, range=0..100), FilletRadius=0)  # -> Polygon, Length
smaller = SmallerThan(FirstNumber=data_3, SecondNumber=Slider(500, range=0..1000))  # -> SmallerThan, OrEqualTo
dispatch_2 = Dispatch(List=polygon.Polygon, DispatchPattern=smaller.SmallerThan)  # -> ListA, ListB
data_4 = Data(dispatch_2.ListB)

# ----
fill = CreateGdiFill(Colour=RGB(0, 0, 0))
data_5 = Data(int_2)
data_6 = Data(int)
data_7 = Data(move_2.Geometry)
rectangle = Rectangle(Plane=data_7, XSize=data_5, YSize=data_6, Radius=0)  # -> Rectangle, Length
rec = Rectangle(rectangle.Rectangle)

# ----
# Take Long Time !!!!!
swatch = ColourSwatch(SwatchColor=RGB(255, 255, 255))
shape = CreateGdiShape(Geometry=data_4, Fill=fill)
draw = DrawImage(
    Shapes=shape,
    Size=rec,
    Factor=Slider(0.2, range=0..1),
    Background=swatch,
    AntiAlias=True,
    FileLocation="C:\Users\40452\OneDrive - Gensler\Desktop\GH_Exported.png")

# ==== cluster Cluster
list = ClusterInput()  # List of domins
dedomain = DeconstructDomain(Domain=list)  # -> Start, End
subtraction = Subtraction(A=dedomain.End, B=dedomain.Start)
abs = Absolute(Value=subtraction)
list_2 = ClusterOutput(abs)  # List of ranges for domins

# ==== cluster Cluster_2
control_num = ClusterInput()
replace_num = ClusterInput()
list = ClusterInput()
data = ClusterInput()
control_num_2 = Data(control_num)
list_2 = Data(list)
data_2 = Data(data)
larger = LargerThan(FirstNumber=data_2, SecondNumber=control_num_2)  # -> LargerThan, OrEqualTo
smaller = SmallerThan(FirstNumber=data_2, SecondNumber=control_num_2)  # -> SmallerThan, OrEqualTo
dispatch = Dispatch(List=list_2, DispatchPattern=larger.OrEqualTo)  # -> ListA, ListB
dispatch_2 = Dispatch(List=list_2, DispatchPattern=smaller.OrEqualTo)  # -> ListA, ListB
lng = ListLength(List=dispatch_2.ListA)
lng_2 = ListLength(List=dispatch.ListA)
dup = DuplicateData(REPLACENUM=replace_num, Number=lng, Order=True)
index = ItemIndex(List=list_2, Item=dispatch_2.ListA)
dup_2 = DuplicateData(REPLACENUM=replace_num, Number=lng_2, Order=True)
index_2 = ItemIndex(List=list_2, Item=dispatch.ListA)
replace = ReplaceItems(List=list_2, Item=dup, Indices=index, Wrap=False)
replace_2 = ReplaceItems(List=list_2, Item=dup_2, Indices=index_2, Wrap=False)
smaller_2 = ClusterOutput(replace)
larger_2 = ClusterOutput(replace_2)
