# Grasshopper definition 021_StepBleacher.gh (Grasshopper 1.0.7)
# plug-ins: Pufferfish

step_length = Slider(300, range=0..1000)
tillstairs = Point(<point referenced from the Rhino model>)
height = Slider(140, range=0..1000)
center = Point(<point referenced from the Rhino model>)
staircase_length = Curve(<curve referenced from the Rhino model>)

# ---- group: bleachers
srf = Surface([<surface referenced from the Rhino model> x20])  # disabled
number_slider = Slider(450, range=0..1000)  # disabled
lng = ListLength(List=srf)  # disabled
brec = BoundingRectangle(Geometry=graft(srf), Plane=PlaneXY(0, 0, 0), Axis=0, Slide=0, Union=True)  # -> Bounding, DimensionX, DimensionY; disabled
series = Series(Start=number_slider, Step=number_slider, Count=lng)  # disabled
area = Area(Geometry=brec.Bounding)  # -> flatten(Area), Centroid; disabled
drec = DeconstuctRectangle(Rectangle=flatten(brec.Bounding))  # -> BasePlane, XInterval, YInterval; disabled
cluster = Cluster(list=drec.YInterval)  # disabled
cluster_2 = Cluster(list=drec.XInterval)  # disabled
multiplication = Multiplication(A=cluster_2, B=cluster)  # disabled
sort = SortList(Keys=cluster_2, ValuesA=srf)  # -> Keys, ValuesA; disabled
Z = UnitZ(Factor=series)  # disabled
extr = Extrude(Base=sort.ValuesA, Direction=Z)  # disabled
group = Group(Objects=extr)  # disabled

# ---- group: one step width line
end = EndPoints(Curve=staircase_length)  # -> Start, End
X = UnitX(Factor=Slider(1200, range=0..10000))
neg = Negative(Value=X)
move = Move(Geometry=end.Start, Motion=neg)  # -> Geometry, Transform
ln = Line(StartPoint=end.Start, EndPoint=move.Geometry)

# ---- group: crv Generate
pi = Pi(Factor=1)
multiplication_2 = Multiplication(A=step_length, B=3)
len = Length(Curve=staircase_length)
neg_2 = Negative(Value=pi)
dom = ConstructDomain(DomainStart=0, DomainEnd=expr("x/2", neg_2))
dist = Distance(PointA=center, PointB=tillstairs)
division = Division(A=len, B=multiplication_2)
arc = Arc(Plane=center, Radius=dist, Angle=dom)  # -> Arc, Length

# ----
addition = Addition(A=division, B=1)

# ---- group: crv Generate (continued)
data = Data(addition)
addition_2 = Addition(A=data, B=1)
series_2 = Series(Start=0, Step=multiplication_2, Count=addition_2)
offset = OffsetCurve(Curve=arc.Arc, Distance=series_2, Corners=1)

# ---- group: step depth
step_depth = Data(step_length)
division_2 = Division(A=len, B=step_depth)

# ---- group: step count
multiplication_3 = Multiplication(A=addition, B=3)
step_count = Data(multiplication_3)

# ---- group: generate Srf
data_2 = Data(flatten(offset))
data_3 = Data(flatten(offset))
dom_2 = ConstructDomain(DomainStart=0, DomainEnd=expr("x-1", data))
dom_3 = ConstructDomain(DomainStart=1, DomainEnd=data)
subset = SubList(List=data_2, Domain=dom_3, Wrap=True)  # -> graft(List), Index
subset_2 = SubList(List=data_2, Domain=dom_2, Wrap=True)  # -> graft(List), Index
loft = Loft(
    Curves=[subset.List, subset_2.List],
    Options={Adjust=False, Closed=False, LoftEnds=0, LoftSimp=0, LoftType=0, Rebuild=10, Refit=0.01})  # -> flatten(Loft)

# ---- group: steps
series_3 = Series(Start=0, Step=step_depth, Count=step_count)
Y = UnitY(Factor=series_3)
neg_3 = Negative(Value=Y)
line = Line(ln)
move_2 = Move(Geometry=line, Motion=neg_3)  # -> Geometry, Transform
Y_2 = UnitY(Factor=step_depth)
data_4 = Data(height)
neg_4 = Negative(Value=Y_2)
extr_2 = Extrude(Base=move_2.Geometry, Direction=neg_4)
series_4 = Series(Start=data_4, Step=data_4, Count=step_count)
Z_2 = UnitZ(Factor=series_4)
extr_3 = Extrude(Base=extr_2, Direction=Z_2)
group_2 = Group(Objects=extr_3)

# ---- group: bleachers
multiplication_4 = Multiplication(A=height, B=3)
srf_2 = Surface(loft)
lng_2 = ListLength(List=srf_2)
brec_2 = BoundingRectangle(Geometry=graft(srf_2), Plane=PlaneXY(0, 0, 0), Axis=0, Slide=0, Union=True)  # -> Bounding, DimensionX, DimensionY
series_5 = Series(Start=multiplication_4, Step=multiplication_4, Count=lng_2)
area_2 = Area(Geometry=brec_2.Bounding)  # -> flatten(Area), Centroid
drec_2 = DeconstuctRectangle(Rectangle=flatten(brec_2.Bounding))  # -> BasePlane, XInterval, YInterval
cluster_3 = Cluster(list=drec_2.YInterval)
cluster_4 = Cluster(list=drec_2.XInterval)
multiplication_5 = Multiplication(A=cluster_4, B=cluster_3)
sort_2 = SortList(Keys=cluster_4, ValuesA=srf_2)  # -> Keys, ValuesA
Z_3 = UnitZ(Factor=series_5)
extr_4 = Extrude(Base=sort_2.ValuesA, Direction=Z_3)
group_3 = Group(Objects=extr_4)

# ---- group: Count Seats
crv = Curve(reparameterize(flatten(offset)))
divdist = DivideDistance(Curve=reparameterize(crv), Distance=Slider(700, range=0..1000))  # -> Points, Tangents, Parameters

# ---- group: exclude point on the end
smaller = SmallerThan(FirstNumber=divdist.Parameters, SecondNumber=Slider(0.9, range=0..1))  # -> SmallerThan, OrEqualTo
larger = LargerThan(FirstNumber=divdist.Parameters, SecondNumber=Slider(0.1, range=0..0.1))  # -> LargerThan, OrEqualTo
and = GateAnd(A=larger.LargerThan, B=smaller.SmallerThan)
dispatch = Dispatch(List=divdist.Points, DispatchPattern=and)  # -> ListA, ListB
data_5 = Data(dispatch.ListA)

# ----
lng_3 = ListLength(List=flatten(data_5))
panel = Panel(lng_3)

# ==== cluster Cluster
list = ClusterInput()  # List of domins
dedomain = DeconstructDomain(Domain=list)  # -> Start, End
subtraction = Subtraction(A=dedomain.End, B=dedomain.Start)
abs = Absolute(Value=subtraction)
list_2 = ClusterOutput(abs)  # List of ranges for domins
