# Grasshopper definition 022_LouverMaker.gh (Grasshopper 1.0.7)
# plug-ins: Python, Pufferfish

number_slider = Slider(0.1, range=0..2, expression="-x")
number_slider_2 = Slider(0.2, range=0..2, expression="-x")
number_slider_3 = Slider(40, range=0..100)
crv = Curve(<curve referenced from the Rhino model>)
crv_2 = Curve(<curve referenced from the Rhino model>)

# ---- group: tweenCrvs
one_over_x = OneOverX(Value=number_slider_3)
series = Series(Start=0, Step=one_over_x, Count=expr("x+1", number_slider_3))
twn2crvs = TweenTwoCurves(CurveA=crv, CurveB=crv_2, Factor=series, Refit=0, PointSample=0)

# ---- group: make tube
number_slider_4 = Slider(0, range=0..100)
crv_3 = Curve(twn2crvs)
pframe = PerpFrame(Curve=reparameterize(crv_3), Parameter=number_slider_4)
pframe_2 = PerpFrame(Curve=reparameterize(crv_3), Parameter=Slider(1, range=0..100))
align = AlignPlane(Plane=pframe_2, Direction=pframe)  # -> Plane, Angle
rectangle = Rectangle(Plane=pframe, XSize=number_slider, YSize=number_slider_2, Radius=0)  # -> Rectangle, Length
rotate = Rotate(Geometry=align.Plane, Angle=3.141592654, Plane=align.Plane)  # -> Geometry, Transform
rectangle_2 = Rectangle(Plane=rotate.Geometry, XSize=number_slider, YSize=number_slider_2, Radius=0)  # -> Rectangle, Length
data = Data(graft(rectangle_2.Rectangle))
data_2 = Data(graft(rectangle.Rectangle))
merge = Merge(Data1=data_2, Data2=data)
swp1 = Sweep1(Rail=graft(crv_3), Sections=merge, Miter=1)
swpcrv = SweepCurve(Rail=crv_3, Section=rectangle_2.Rectangle, Plane=pframe, Parameter=number_slider_4)  # disabled

# ----
data_3 = Data(crv)

# ---- group: mirro
item = ListItem(List=pframe, Index=0, Wrap=True)
mirror = Mirror(Geometry=swp1, Plane=item)  # -> Geometry, Transform

# ----
mirror_2 = Mirror(Geometry=data_3, Plane=item)  # -> Geometry, Transform
crv_4 = Curve(<curve referenced from the Rhino model>)
loft = Loft(
    Curves=flatten([data_3, crv_4, mirror_2.Geometry]),
    Options={Adjust=False, Closed=False, LoftEnds=0, LoftSimp=0, LoftType=0, Rebuild=10, Refit=0.01})
group = Group(Objects=flatten([mirror.Geometry, swp1]))
