# Grasshopper definition 023_BlockbyInstance.gh (Grasshopper 1.0.7)
# plug-ins: EleFront

geo = Geometry([<brep referenced from the Rhino model> x19])
lng = ListLength(List=geo)  # -> flatten(Length)
pt = ConstructPoint(XCoordinate=0, YCoordinate=0, ZCoordinate=0)
series = Series(Start=0, Step=1, Count=lng)  # -> flatten(Series)
concat = Concatenate(FragmentA="RH_", FragmentB=series)
block = DefineBlock(Geometry=graft(geo), BlockName=graft(concat), BasePlane=pt)  # -> flatten(Block)
data = Data(block)
