# Grasshopper definition 024_PlanterMaker.gh (Grasshopper 1.0.8)

offset = Slider(450, range=0..1000, expression="-X")
move_up = Slider(600, range=0..1000)
crv = Curve(<curve referenced from the Rhino model>)
Z = UnitZ(Factor=move_up)
move = Move(Geometry=crv, Motion=Z)  # -> Geometry, Transform
offset_2 = OffsetCurve(Curve=crv, Distance=Slider(300, range=0..1000, expression="-X"), Corners=1)
offset_3 = OffsetCurve(Curve=move.Geometry, Distance=offset, Corners=1)
runion = RegionUnion(Curves=flatten(move.Geometry))

number_slider = Slider(20, range=0..100, expression="-X")
Z_2 = UnitZ(Factor=number_slider)
offset_4 = OffsetCurve(Curve=runion, Distance=expr("X", number_slider), Corners=1)
move_2 = Move(Geometry=runion, Motion=Z_2)  # -> Geometry, Transform

runion_2 = RegionUnion(Curves=flatten(offset_3))
runion_3 = RegionUnion(Curves=flatten(offset_2))
data = Data(runion)
data_2 = Data(flatten([runion_2, offset_4]))

offset_5 = OffsetCurve(Curve=runion_2, Distance=Slider(50, range=0..100, expression="-X"), Corners=1)
boundary = BoundarySurfaces(Edges=flatten([offset_5, runion_2]))
Z_3 = UnitZ(Factor=Slider(300, range=0..1000))
Z_4 = UnitZ(Factor=expr("-X", Slider(250, range=0..1000)))
extr = Extrude(Base=boundary, Direction=Z_3)
move_3 = Move(Geometry=extr, Motion=Z_4)  # -> Geometry, Transform

loft = Loft(
    Curves=flatten([offset_4, move_2.Geometry]),
    Options={Adjust=False, Closed=False, LoftEnds=0, LoftSimp=0, LoftType=3, Rebuild=10, Refit=0.01})
loft_2 = Loft(Curves=data_2, Options={Adjust=False, Closed=False, LoftEnds=0, LoftSimp=0, LoftType=3, Rebuild=10, Refit=0.01})
loft_3 = Loft(
    Curves=[move_2.Geometry, runion_3],
    Options={Adjust=False, Closed=False, LoftEnds=0, LoftSimp=0, LoftType=3, Rebuild=10, Refit=0.01})
join = BrepJoin(Breps=[loft_2, loft, loft_3])  # -> Breps, Closed

number_slider_2 = Slider(7, range=0..10)  # disabled
number_slider_3 = Slider(20, range=0..100)  # disabled
edges = BrepEdges(Brep=loft_2)  # -> Naked, Interior, NonManifold; disabled
curvepoint = PointOnCurve(edges.Interior, parameter=0.5)  # disabled
points = PointList(Points=curvepoint)  # disabled
filedge = FilletEdge(Shape=loft_2, Blend=0, Metric=0, Edges=number_slider_2, Radii=number_slider_3)  # disabled

boundary_2 = BoundarySurfaces(Edges=runion_2)
move_4 = Move(Geometry=boundary_2, Motion=Z_4)  # -> Geometry, Transform

group = Group(Geometry=flatten([move_4.Geometry, move_3.Geometry, join.Breps]))
