# Grasshopper definition 026_GradientPattern.gh (Grasshopper 1.0.8)

number_slider = Slider(80, range=0..100)
number_slider_2 = Slider(18, range=0..100)

series = Series(Start=0, Step=1, Count=number_slider)
dom = ConstructDomain(DomainStart=Slider(15, range=0..100), DomainEnd=Slider(50, range=0..100))
bnd = Bounds(Numbers=series)
remap = RemapNumbers(Value=series, Source=bnd, Target=dom)  # -> graft(Mapped), Clipped

trigrid = Triangular(Plane=PlaneXY(0, 0, 0), Size=Slider(300, range=0..1000), ExtentX=number_slider, ExtentY=number_slider_2)  # -> Cells, Points
neg = Negative(Value=Slider(5, range=0..10))
offset = OffsetCurve(Curve=trigrid.Cells, Distance=neg, Corners=1)

# ---- group: 连接角的线
cp = ControlPoints(Curve=trigrid.Cells)  # -> Points, Weights, Knots
area = Area(Geometry=trigrid.Cells)  # -> Area, Centroid
split = SplitList(List=cp.Points, Index=Slider(3, range=0..10))  # -> ListA, ListB
ln = Line(StartPoint=graft(area.Centroid), EndPoint=split.ListA)

# ---- group: 复制数据到同样的结构
repeat = RepeatData(Data=remap.Mapped, Length=number_slider_2)  # -> graft(Data)
repeat_2 = RepeatData(Data=repeat, Length=Slider(3, range=0..10))  # -> simplify(Data)

# ----
data = Data(offset)

# ---- group: 将线给予厚度
len = Length(Curve=ln)
neg_2 = Negative(Value=repeat_2)
hframe = HorizontalFrame(Curve=ln, Parameter=Slider(0, range=0..1))
dom_2 = ConstructDomain(DomainStart=repeat_2, DomainEnd=neg_2)
rectangle = Rectangle(Plane=hframe, XSize=len, YSize=dom_2, Radius=0)  # -> Rectangle, Length

# ---- group: 图形计算
rdiff = RegionDifference(CurvesA=data, CurvesB=rectangle.Rectangle)
data_2 = Data(rdiff)
boundary = BoundarySurfaces(Edges=data_2)

# ----
group = Group(Geometry=flatten(rdiff))
group_2 = Group(Geometry=flatten(boundary))
