# Grasshopper definition 20240528_bilibili_N31F_MockUp.gh (Grasshopper 1.0.7)
# plug-ins: Pufferfish

divide_height = Slider(2300, range=0..10000)
bottomcrv = Curve(<curve referenced from the Rhino model>)

offset_front = Slider(150, range=0..1000)
offset_support = Slider(150, range=0..1000)

support_thick_2 = Slider(20, range=0..100)
front_thick_2 = Slider(40, range=0..100)

# ---- group: Upper Srf
srf = Surface([<surface referenced from the Rhino model> x3])

# ---- group: Bottom Srf
srf_2 = Surface([<surface referenced from the Rhino model> x3])

# ---- group: Divide Base Crv
Z = UnitZ(Factor=divide_height)
move = Move(Geometry=bottomcrv, Motion=Z)  # -> Geometry, Transform
divide = DivideCurve(Curve=move.Geometry, Count=Slider(80, range=0..100), Kinks=False)  # -> Points, Tangents, Parameters

# ---- group: Get Verticle Divide
srf_cp = SurfaceClosestPoint(Point=divide.Points, Surface=graft(srf))  # -> Point, UVPoint, Distance
larger = LargerThan(FirstNumber=srf_cp.Distance, SecondNumber=Slider(0.1, range=0..0.1))  # -> LargerThan, OrEqualTo
dispatch = Dispatch(List=srf_cp.UVPoint, DispatchPattern=larger.LargerThan)  # -> ListA, ListB
iso = IsoCurve(Surface=graft(srf), UVPoint=dispatch.ListB)  # -> UIsocurve, VIsocurve
data = Data(iso.UIsocurve)

srf_cp_2 = SurfaceClosestPoint(Point=divide.Points, Surface=graft(srf_2))  # -> Point, UVPoint, Distance
larger_2 = LargerThan(FirstNumber=srf_cp.Distance, SecondNumber=Slider(0.1, range=0..0.1))  # -> LargerThan, OrEqualTo
dispatch_2 = Dispatch(List=srf_cp_2.UVPoint, DispatchPattern=larger_2.LargerThan)  # -> ListA, ListB
iso_2 = IsoCurve(Surface=graft(srf_2), UVPoint=dispatch_2.ListB)  # -> UIsocurve, VIsocurve
data_2 = Data(iso_2.UIsocurve)

# ---- group: Offset Control
addition = Addition(A=offset_front, B=offset_support)
offset_l = OffsetCurveLoose(Curve=data, Distance=offset_front, Plane=data)
offset_l_2 = OffsetCurveLoose(Curve=data, Distance=addition, Plane=data)
offset_l_3 = OffsetCurveLoose(Curve=data_2, Distance=offset_front, Plane=data)
offset_l_4 = OffsetCurveLoose(Curve=data_2, Distance=addition, Plane=data)

# ---- group: Loft Brep
loft = Loft(
    Curves=[data_2, offset_l_3],
    Options={Adjust=True, Closed=False, LoftEnds=0, LoftSimp=0, LoftType=0, Rebuild=10, Refit=0.01})  # -> flatten(Loft)
data_3 = Data(front_thick_2)
neg = Negative(Value=data_3)
offsrf = OffsetSurface(Surface=loft, Distance=data_3, BothSides=neg, CreateSolid=True)

loft_2 = Loft(
    Curves=[offset_l_4, offset_l_3],
    Options={Adjust=False, Closed=False, LoftEnds=0, LoftSimp=0, LoftType=0, Rebuild=10, Refit=0.01})  # -> flatten(Loft)
neg_2 = Negative(Value=support_thick_2)
offsrf_2 = OffsetSurface(Surface=loft_2, Distance=support_thick_2, BothSides=neg_2, CreateSolid=True)

loft_3 = Loft(Curves=[data, offset_l], Options={Adjust=True, Closed=False, LoftEnds=0, LoftSimp=0, LoftType=0, Rebuild=10, Refit=0.01})  # -> flatten(Loft)
data_4 = Data(front_thick_2)
neg_3 = Negative(Value=data_4)
offsrf_3 = OffsetSurface(Surface=loft_3, Distance=data_4, BothSides=neg_3, CreateSolid=True)

loft_4 = Loft(
    Curves=[offset_l_2, offset_l],
    Options={Adjust=False, Closed=False, LoftEnds=0, LoftSimp=0, LoftType=0, Rebuild=10, Refit=0.01})  # -> flatten(Loft)
data_5 = Data(support_thick_2)
neg_4 = Negative(Value=data_5)
offsrf_4 = OffsetSurface(Surface=loft_4, Distance=data_5, BothSides=neg_4, CreateSolid=True)

# ---- group: Round Edge
filedge = FilletEdge(Shape=offsrf, Blend=0, Metric=0, Edges=Slider(9, range=0..10), Radii=graft(Slider(80, range=0..100)))

# ---- group: Output
group = Group(Objects=flatten([filedge, offsrf_2, offsrf_4, offsrf_3]))
