# Grasshopper definition SpiralStaircase.ghx (Grasshopper 1.0.7)

handrail_height = Slider(1000, range=0..1000)
step_height = Slider(100, range=0..1000)
overall_height = Slider(3800, range=0..10000)
number_slider = Slider(28, range=0..100)
step_count = Slider(28, range=0..100)
inner_radius = Slider(828, range=0..1000)
outline_radius = Slider(2777, range=0..10000)
basepoint = Point(<point referenced from the Rhino model>)
cir = Circle(Plane=basepoint, Radius=outline_radius)
cir_2 = Circle(Plane=basepoint, Radius=inner_radius)
division = Division(A=overall_height, B=step_count)
divide = DivideCurve(Curve=cir, Count=number_slider, Kinks=False)  # -> Points, Tangents, Parameters
divide_2 = DivideCurve(Curve=cir_2, Count=number_slider, Kinks=False)  # -> Points, Tangents, Parameters
series = Series(Start=0, Step=division, Count=step_count)
shift = ShiftList(List=divide.Points, Shift=1, Wrap=True)
shift_2 = ShiftList(List=divide_2.Points, Shift=1, Wrap=True)
Z = UnitZ(Factor=series)
entwine = Entwine(Branch00=shift_2, Branch01=divide_2.Points, Branch02=divide.Points, Branch03=shift, FlattenInputs=True)
flip = FlipMatrix(Data=entwine)
move = Move(Geometry=flatten(shift), Motion=Z)  # -> Geometry, Transform
move_2 = Move(Geometry=flatten(shift_2), Motion=Z)  # -> Geometry, Transform
pline = PolyLine(Vertices=flip, Closed=True)
Z_2 = UnitZ(Factor=step_height)
move_3 = Move(Geometry=flatten(pline), Motion=Z)  # -> Geometry, Transform
intcrv = Interpolate(Vertices=move_2.Geometry, Degree=3, Periodic=False, KnotStyle=1)  # -> Curve, Length, Domain
boundary = BoundarySurfaces(Edges=move_3.Geometry)
intcrv_2 = Interpolate(Vertices=move.Geometry, Degree=3, Periodic=False, KnotStyle=1)  # -> Curve, Length, Domain
Z_3 = UnitZ(Factor=handrail_height)
extr = Extrude(Base=boundary, Direction=Z_2)
group = Group(Objects=extr)
move_4 = Move(Geometry=[intcrv_2.Curve, intcrv.Curve], Motion=Z_3)  # -> Geometry, Transform
extr_2 = Extrude(Base=[intcrv_2.Curve, intcrv.Curve], Direction=Z_3)
pipe = Pipe(Curve=move_4.Geometry, Radius=Slider(30, range=0..100), Caps=0)
