# Grasshopper definition staircase_maker.gh (Grasshopper 1.0.7)
# plug-ins: Pufferfish, Speckle.Connector.Grasshopper

踏步深度 = Slider(280, range=0..1000)
踏步高度 = Slider(75, range=0..100)
斜坡宽度 = Slider(800, range=0..1000)
inner = Curve([<curve referenced from the Rhino model> x13])
outer = Curve([<curve referenced from the Rhino model> x13])
number_slider = Slider(50, range=0..100)
cluster = Cluster_2(踏步高度=踏步高度, 踏步深度=踏步深度, step_crvs=outer, layer_name_in_text="PLATFORM")  # -> 所有边线_2, 平台线_2, 踏步线_2
cluster_2 = Cluster_2(踏步高度=踏步高度, 踏步深度=踏步深度, step_crvs=inner, layer_name_in_text="PLATFORM")  # -> 所有边线_2, 平台线_2, 踏步线_2
平台线b = Data(graft(cluster_2.平台线_2), AlwaysInheritNames=False, CanInheritNames=True)
平台线a = Data(graft(cluster.平台线_2), AlwaysInheritNames=False, CanInheritNames=True)
data = Data(cluster.所有边线_2, AlwaysInheritNames=False, CanInheritNames=True)
data_2 = Data(cluster_2.所有边线_2, AlwaysInheritNames=False, CanInheritNames=True)
flip = FlipCurve(Curve=平台线b)  # -> Curve, Flag
join = JoinCurves(Curves=data_2, Preserve=False)  # -> flatten(Curves)
join_2 = JoinCurves(Curves=data, Preserve=False)
loft = Loft(
    Curves=[flip.Curve, 平台线a],
    Options={Adjust=False, Closed=False, LoftEnds=0, LoftSimp=0, LoftType=0, Rebuild=10, Refit=0.01})

# ---- group: 生成踏步
data_3 = Data(cluster.踏步线_2, AlwaysInheritNames=False, CanInheritNames=True)
data_4 = Data(cluster_2.踏步线_2, AlwaysInheritNames=False, CanInheritNames=True)
cluster_3 = Cluster(data_2=data_4, data=踏步高度)
cluster_4 = Cluster(data_2=data_3, data=踏步高度)
data_5 = Data(graft(cluster_3))
data_6 = Data(graft(cluster_4))
loft_2 = Loft(
    Curves=[data_6, data_5],
    Options={Adjust=False, Closed=False, LoftEnds=0, LoftSimp=0, LoftType=0, Rebuild=10, Refit=0.01})

# ----
Z = UnitZ(Factor=Slider(900, range=0..1000))

# ---- group: 斜坡
multiplication = Multiplication(A=踏步高度, B=2)
offcrv = OffsetCurve(Curve=join, Plane=PlaneXY(0, 0, 0), Distance=expr("-x", 斜坡宽度), BothSides=0, Kinks=0, CapType=0)  # -> flatten(Offset)
Z_2 = UnitZ(Factor=multiplication)
loft_3 = Loft(Curves=[offcrv, join], Options={Adjust=False, Closed=False, LoftEnds=0, LoftSimp=0, LoftType=0, Rebuild=10, Refit=0.01})
extr = Extrude(Base=loft_3, Direction=Z_2)

# ---- group: 踏步
Z_3 = UnitZ(Factor=踏步高度)
extr_2 = Extrude(Base=flatten([loft_2, loft]), Direction=Z_3)
group = Group(Objects=extr_2)

# ---- group: 栏杆 外
offcrv_2 = OffsetCurve(Curve=offcrv, Plane=PlaneXY(0, 0, 0), Distance=number_slider, BothSides=0, Kinks=0, CapType=0)
loft_4 = Loft(
    Curves=flatten([offcrv, offcrv_2]),
    Options={Adjust=False, Closed=False, LoftEnds=0, LoftSimp=0, LoftType=0, Rebuild=10, Refit=0.01})
extr_3 = Extrude(Base=flatten(loft_4), Direction=Z)

# ---- group: 栏杆 内
extr_4 = Extrude(Base=flatten(join_2), Direction=Z)
offsrf = OffsetSurface(Surface=extr_4, Distance=expr("-x", number_slider), BothSides=0, CreateSolid=True)

# ----
group_2 = Group(Geometry=flatten([offsrf, extr, extr_3, group]))

# ==== cluster Cluster
data = ClusterInput()
data_2 = ClusterInput()
data_3 = Data(data)
data_4 = Data(graft(data_2))
end = EndPoints(Curve=data_4)  # -> Start, End
len = Length(Curve=data_4)
pdecon = Deconstruct(Point=end.Start)  # -> XComponent, YComponent, ZComponent
pdecon_2 = Deconstruct(Point=end.End)  # -> XComponent, YComponent, ZComponent
subtraction = Subtraction(A=pdecon.ZComponent, B=pdecon_2.ZComponent)
abs = Absolute(Value=subtraction)
division = Division(A=abs, B=graft(data_3))
divide = DivideCurve(Curve=data_4, Count=division, Kinks=False)  # -> Points, Tangents, Parameters

# ---- group: move up points
Z = UnitZ(Factor=data_3)
move = Move(Geometry=divide.Points, Motion=Z)  # -> Geometry, Transform
lng = ListLength(List=move.Geometry)
subtraction_2 = Subtraction(A=lng, B=1)
split = SplitList(List=move.Geometry, Index=subtraction_2)  # -> ListA, ListB

# ----
split_2 = SplitList(List=divide.Points, Index=1)  # -> ListA, ListB
data_5 = Data(split_2.ListB)
data_6 = Data(split.ListA)
ln = Line(StartPoint=data_5, EndPoint=data_6)
L = ClusterOutput(ln)

# ==== cluster Cluster_2
踏步高度 = ClusterInput()
踏步深度 = ClusterInput()
step_crvs = ClusterInput()
layer_name_in_text = ClusterInput()
踏步高度_2 = Data(踏步高度)
踏步深度_2 = Data(踏步深度)
step_crvs_2 = Data(step_crvs, AlwaysInheritNames=False, CanInheritNames=True)
layer_name_in_text_2 = Data(layer_name_in_text, AlwaysInheritNames=False, CanInheritNames=True)

# ---- group: 哪些是平台
filterlay = FilterByLayer(Layer=layer_name_in_text_2, Geometry=step_crvs_2, invertFilter=False, returnNulls=False)  # -> ExcludedGeometry, IncludedGeometry
platform = Data(filterlay.IncludedGeometry, AlwaysInheritNames=False, CanInheritNames=True)
index = ItemIndex(List=step_crvs_2, Item=platform)

# ---- group: 计算分割数
len = Length(Curve=graft(step_crvs_2))
division = Division(A=len, B=踏步深度_2)
int = Integer(division)
multiplication = Multiplication(A=int, B=踏步高度_2)

# ---- group: 将平台抬升高度设为0
各层根据长度计算抬升高度 = Data(flatten(multiplication), AlwaysInheritNames=False, CanInheritNames=True)
replace = ReplaceItems(List=各层根据长度计算抬升高度, Item=Slider(0, range=0..100), Indices=index, Wrap=False)
data = Data(replace, AlwaysInheritNames=False, CanInheritNames=True)

# ---- group: 从0上升高度
lng = ListLength(List=step_crvs_2)
series = Series(Start=0, Step=1, Count=expr("X-1", lng))
dom = ConstructDomain(DomainStart=0, DomainEnd=series)
subset = SubList(List=data, Domain=dom, Wrap=True)  # -> List, Index
number_slider = Slider(0, range=0..100)
ma = MassAddition(Input=subset.List)  # -> flatten(Result), PartialResults
ins = InsertItems(List=ma.Result, Item=number_slider, Indices=number_slider, Wrap=True)
Z = UnitZ(Factor=ins)

# ---- group: 根据高度重新连线
Z_2 = UnitZ(Factor=data)
end = EndPoints(Curve=step_crvs_2)  # -> Start, End
move = Move(Geometry=end.End, Motion=Z_2)  # -> Geometry, Transform
ln = Line(StartPoint=end.Start, EndPoint=move.Geometry)

# ---- group: 替换回原本的平台线
replace_2 = ReplaceItems(List=ln, Item=platform, Indices=index, Wrap=False)

# ----
move_2 = Move(Geometry=replace_2, Motion=Z)  # -> Geometry, Transform
dispdexs = DispatchIndices(List=move_2.Geometry, Indices=index)  # -> AtI, NotI
所有边线 = Data(move_2.Geometry, AlwaysInheritNames=False, CanInheritNames=True)
平台线 = Data(dispdexs.AtI, AlwaysInheritNames=False, CanInheritNames=True)
踏步线 = Data(dispdexs.NotI, AlwaysInheritNames=False, CanInheritNames=True)
所有边线_2 = ClusterOutput(所有边线)
平台线_2 = ClusterOutput(平台线)
踏步线_2 = ClusterOutput(踏步线)
